# Grasshopper definition aula_1.gh (Grasshopper 0.9.76)

# https://www.youtube.com/watch?v=pFCrIzENDn8&list=PLapoQ_9M-ujfYGOsZProIXPGx-HRfjJ9C
# 
# parada 1:14
number_slider = Slider(1, range=0..1)
c_script = CSharpScript(x=number_slider, y=Slider(2, range=0..2), z=Slider(1, range=0..1))  # -> out, A, B; inputs x: Double, y: Double, z: Double
# ---------- c_script: C# ----------
    //Point3d myPoint = new Point3d(1.0, 2.0, 3.0);
    //A = myPoint;

    //if (x > y)
    //{
    //  Print("x is bigger than y");
    //  Print("y is smaller than x");
    //}
    //else
    //{
    //  Print("x is smaller than y");
    //  Print("y is bigger than x");
    //}

    for (int i = 0; i < 5; i++)
    {
      Print(i.ToString());
    }
# ---------- end c_script ----------
panel = Panel(c_script.out)
panel_2 = Panel(c_script.A)
panel_3 = Panel(c_script.B)
